# Dynamo graph AHN3.dyn (Dynamo 1.3.3.4111)

downloadAHN = Custom[GIS2BIM.DownloadAHN]()  # get the mapnumber(s) of the AHN based on a given boundingbox; unwired: Urlwebrequest
code_block = CodeBlock { "dordrecht"; "zuidendijk"; "315"; }
getLocationdataNetherlands = Custom[GIS2BIM.GetLocationdataNetherlands](City=code_block.out0, Streetname=code_block.out1, Housenumber=code_block.out2)  # Gives locationdata based on an adress in the Netherlands
code_block_2 = CodeBlock { 400; }
createBoundingBox = Custom[GIS2BIM.CreateBoundingBox](CoordinateX=getLocationdataNetherlands.RDcoordinateX_meters_double, CoordinateY=getLocationdataNetherlands.RDcoordinateY_meters_double, BoxWidth=code_block_2, BoxHeight=code_block_2)  # create boundingboxstring for webrequests based on coördinates and dimensions
geoservicesLibraryNetherlands = Custom[GIS2BIM.GeoservicesLibraryNetherlands](BoundingBox=createBoundingBox.Boxstring)  # Library with multiple webadresses which can be used for WFS and WMS webrequests
openBrowser = Custom[GIS2BIM.OpenBrowser]()  # Opens a new window in your default browser with the given url.; unwired: url
web_request = WebRequest(getLocationdataNetherlands.URLWebrequest)
string = StringInput("\"identificatie\":\"")
split = String.Split(web_request, string)
code_block_3 = CodeBlock(x=split) { x[1]; }
string_2 = StringInput("\",")
split_2 = String.Split(code_block_3, string_2)
code_block_4 = CodeBlock(x=split_2) { identificatie=x[0]; }
string_3 = StringInput("\"id\":\"")
split_3 = String.Split(web_request, string_3)
code_block_5 = CodeBlock(x=split_3) { x[1]; }
string_4 = StringInput("\",")
split_4 = String.Split(code_block_5, string_4)
code_block_6 = CodeBlock(x=split_4) { id=x[0]; }
