# Dynamo graph AHN_CloudCompare.dyn (Dynamo 1.3.2.2480)

# group: INPUT
code_block = CodeBlock { "Den Bommel"; "Bommelsedijk"; "1"; }
directory_laszip = CodeBlock { "C:/TEMP"; }
filepath_laz_pointcloud = Filename("\\Nas_archief\geo\u19an1.laz")
boundingbox = CodeBlock { 200; }
new_filename = CodeBlock { "846_strand.laz"; }

getLocationdataNetherlands = Custom[GIS2BIM.GetLocationdataNetherlands](City=code_block.out0, Streetname=code_block.out1, Housenumber=code_block.out2)  # Gives locationdata based on an adress in the Netherlands
string = StringInput("""import sys
sys.path.append("C:\Program Files (x86)\IronPython 2.7\Lib")
import webbrowser

links = IN[0]

for link in links:
 webbrowser.open(link)
 
OUT = links""")
open_downloadlink = PythonStringNode(script=string)  # unwired: IN[0]
code_block_2 = CodeBlock { "28992"; }
code_block_3 = CodeBlock { "52.6970785"; "4.6350438"; }
transformCRS_epsg = Custom[GIS2BIM.TransformCRS_epsg](targetCRS=code_block_2, xCoordinate=code_block_3.out1, yCoordinate=code_block_3.out0)  # Uses the API of http://epsg.io to transform Coordinate Reference Systems
code_block_4 = CodeBlock(x=transformCRS_epsg.Xtransformed, y=transformCRS_epsg.Ytransformed, width=boundingbox) { x; y; width; }

# group: CREATE BATCHFILE
code_block_5 = CodeBlock { "/"; "cropped5.bat"; }
concat = String.Concat(directory_laszip, code_block_5.out0, code_block_5.out1)
downloadLASZIP = Custom[GIS2BIM.DownloadLASZIP](Directory=directory_laszip)  # download and unzip laszip
code_block_6 = CodeBlock { " -i "; }
code_block_7 = CodeBlock { "-keep_classification 2 "; ""; " -oparse xyz"; }
string_2 = StringInput("\"")
code_block_8 = CodeBlock { " -translate_x -"; " -translate_y -"; }
toString = Custom[Springs.Number.ToString](num=code_block_4.x)  # Converts the input number(s) to string. You can optionally limit the number of digits.
toString_2 = Custom[Springs.Number.ToString](num=code_block_4.y)
code_block_9 = CodeBlock { " -inside "; " "; }
code_block_10 = CodeBlock(x=code_block_4.x, bbox=code_block_4.width, y=code_block_4.y) { x-0.5*bbox; x+0.5*bbox; y-0.5*bbox; y+0.5*bbox; }
toString_3 = Custom[Springs.Number.ToString](num=code_block_10.out0)
toString_4 = Custom[Springs.Number.ToString](num=code_block_10.out2)
toString_5 = Custom[Springs.Number.ToString](num=code_block_10.out1)
toString_6 = Custom[Springs.Number.ToString](num=code_block_10.out3)
code_block_11 = CodeBlock { " -odir "; " -o "; }
string_3 = StringInput("\"")
concat_2 = String.Concat(downloadLASZIP.Laszip, code_block_6, code_block_7.out1, string_2, filepath_laz_pointcloud, string_2, code_block_8.out0, toString, code_block_8.out1, toString_2, code_block_9.out0, toString_3, code_block_9.out1, toString_4, code_block_9.out1, toString_5, code_block_9.out1, toString_6, code_block_11.out0, string_2, directory_laszip, string_2, code_block_11.out1, string_3, new_filename, string_3)  # unwired: arg26
writeToFile = CSV.WriteToFile(concat, concat_2)

code_block_12 = CodeBlock { "luchtfoto"; }
webrequestWMS = Custom[GIS2BIM.WebrequestWMS](View=code_block_12)  # a webrequest based on WMS-protocol; unwired: WMSwebrequest, Tempfolder, Filename
createBoundingBox = Custom[GIS2BIM.CreateBoundingBox](CoordinateX=transformCRS_epsg.Xtransformed, CoordinateY=transformCRS_epsg.Ytransformed, BoxWidth=boundingbox, BoxHeight=boundingbox)  # create boundingboxstring for webrequests based on coördinates and dimensions
geoservicesLibraryNetherlands = Custom[GIS2BIM.GeoservicesLibraryNetherlands](BoundingBox=createBoundingBox.Boxstring)  # Library with multiple webadresses which can be used for WFS and WMS webrequests
webrequestWMS_2 = Custom[GIS2BIM.WebrequestWMS](WMSwebrequest=geoservicesLibraryNetherlands.5_luchtfoto_2016_WMS, Filename=code_block_12)
watch_image = WatchImageCore(webrequestWMS_2.watch_image)
downloadAHN = Custom[GIS2BIM.DownloadAHN](Urlwebrequest=geoservicesLibraryNetherlands.11_AHN2_webrequest_bladindex)  # get the mapnumber(s) of the AHN based on a given boundingbox
sendTo = Custom[Clipboard.SendTo](str=downloadAHN.Downloadlink_AHN2_uitgefilterd)  # Copies a string to the clipboard.
