# Dynamo graph AHN_CloudCompareImportMesh.dyn (Dynamo 1.3.2.2480)

file_path = Filename("..\..\..\..\..\..\..\TEMP\test4.obj")
importFile = Autodesk.Dynamo.MeshToolkit.Mesh.ImportFile(file_path)
code_block = CodeBlock { 100000; }
reduce = Autodesk.Dynamo.MeshToolkit.Mesh.Reduce(importFile, code_block)
toolkitMeshToMesh = Custom[Springs.ToolkitMeshToMesh](tkMesh=reduce)  # Attempts to convert a toolkit mesh to a Dynamo mesh. You obviously need to have the appropriate version of the mesh toolkit package downloaded first.
categories = Categories("GenericModel")
code_block_2 = CodeBlock { "000_MA_bestaande bebouwing_IP"; }
byName = Material.ByName(code_block_2)
byMesh = DirectShape.ByMesh(toolkitMeshToMesh, categories, byName)
code_block_3 = CodeBlock { "Reeuwijk-Dorp"; "Kerkweg"; "1"; }
getLocationdataNetherlands = Custom[GIS2BIM.GetLocationdataNetherlands](City=code_block_3.out0, Streetname=code_block_3.out1, Housenumber=code_block_3.out2)  # Gives locationdata based on an adress in the Netherlands
setSharedCoordinate = Custom[GIS2BIM.SetSharedCoordinate](X=getLocationdataNetherlands.RDcoordinate_X_meters, Y=getLocationdataNetherlands.RDcoordinate_Y_meters)  # Set shared coordinate/project basepoint
