# Dynamo graph BGT New 3.dyn (Dynamo 2.10.1.3976)
# packages: GIS2BIM for Dynamo 2.x 0.11.19

string = StringInput("{\"featuretypes\":[\"waterdeel\"],\"format\":\"gmllight\",\"geofilter\":\"POLYGON((213089 593892, 217076 593892, 217076 597981, 213089 597981, 213089 593892))\"}")
string_2 = StringInput(")\"}")
code_block = CodeBlock { "https://download.pdok.io/lv/bgt/api/v1/extract/"; "55359369-f738-4618-a933-38c701c5463c"; "/extract.zip"; }
string_3 = StringInput("{\"featuretypes\":[")
string_4 = StringInput("\"waterdeel\"")
string_5 = StringInput("],\"format\":\"gmllight\",\"geofilter\":\"POLYGON(")
code_block_2 = CodeBlock { "Dordrecht"; "werf van schouten"; "501"; }
GIS2BIM_GetLocationdataNetherlands = Custom[GIS2BIM_GetLocationdataNetherlands](City=code_block_2.out0, Streetname=code_block_2.out1, Housenumber=code_block_2.out2)  # package GIS2BIM for Dynamo 2.x; Gives locationdata based on an adress in the Netherlands
code_block_3 = CodeBlock { 400; }
GIS2BIM_CreateBoundingBox = Custom[GIS2BIM_CreateBoundingBox](CoordinateX=GIS2BIM_GetLocationdataNetherlands.RDcoordinateXmeters, CoordinateY=GIS2BIM_GetLocationdataNetherlands.RDcoordinateYmeters, BoxWidth=code_block_3, BoxHeight=code_block_3)  # package GIS2BIM for Dynamo 2.x; create boundingboxstring for webrequests based on coördinates and dimensions
string_6 = StringInput(")\"}")
concat = String.Concat(string0=string_3, string1=string_4, string2=string_5, string3=GIS2BIM_CreateBoundingBox.PolygonString, string4=string_6)
python_script = Python(IN[0]=concat)  # CPython3
# ---------- python_script.python (22 lines) ----------
import sys
import clr
import json

sys.path.append(r'C:\Users\mikev\AppData\Roaming\Python\Python37\site-packages')
import requests
from requests.structures import CaseInsensitiveDict

url = "https://api.pdok.nl/lv/bgt/download/v1_0/full/custom"

headers = CaseInsensitiveDict()
headers["accept"] = "application/json"
headers["Content-Type"] = "application/json"

data = IN[0]

resp = requests.post(url, headers=headers, data=data)

jsondata = json.loads(resp.text)
data = jsondata["downloadRequestId"]

OUT = data
# ----------------------------------------
concat_2 = String.Concat(string0=code_block.out0, string1=python_script, string2=code_block.out2)
GIS2BIM_OpenBrowser = Custom[GIS2BIM_OpenBrowser](url=concat_2)  # package GIS2BIM for Dynamo 2.x; Opens a new window in your default browser with the given url.
