# Dynamo graph BGT-Lines2.dyn (Dynamo 1.3.3.4111)

TEMPfolder = StringInput("C:\TEMP")
code_block = CodeBlock { 106436; 425689; }
# note: It will take quite some time to run this node. It can take 10 minutes. When you run parts of it it will be quicker. Open the file: GIStoBIM1.rvt from the package-folder to use the standard filled regions and linetypes.
getMortonCodeCoordinate = Custom[GIS2BIM.GetMortonCodeCoordinate](X=code_block.out0, Y=code_block.out1)  # Get mortoncode given 2 coordinates and tiledimension
string = StringInput("C:\TEMP")
downloadBGTdata = Custom[GIS2BIM.DownloadBGTdata](Mortoncode=getMortonCodeCoordinate, Directory=string)  # frozen; Download BGT-data(dutch GIS-information)
unzipFile = Custom[GIS2BIM.UnzipFile](FilePathZipFile=downloadBGTdata.Location, DirectoryToExtractTo=downloadBGTdata.Directory)  # Unzip zip-file

# group: 2D SETTINGS
# note: Panden;
# 0 bgt_overigbouwwerk;
# Groen;
# 1 bgt_begroeidterreindeel;
# Lijnen(aparte lagen);
# 2 bgt_functioneelgebied;
# 3 bgt_gebouwinstallatie;
# 4 bgt_kunstwerkdeel;
# 5 bgt_onbegroeidterreindeel;
# 6 bgt_ondersteunendwegdeel;
# 7 bgt_overigescheiding;
# 8 bgt_scheiding;
# 9 bgt_spoor;
# 10 bgt_tunneldeel;
# Wegen bruggen en kunstwerken;
# 11 bgt_kunstwerkdeel;
# 12 bgt_overbruggingsdeel;
# 13 bgt_wegdeel;
# Water;
# 14 bgt_ondersteunendwaterdeel;
# 15 bgt_waterdeel;
# Labels;
# 16 bgt_openbareruimtelabel;
# Puntobject;
# 17 bgt_vegetatieobject;
tree = FamilyTypes("90_DI_boom:90_DI_boom")
line_styles = CodeBlock()
# ---------- line_styles.designscript (9 lines) ----------
"bgt_functioneelgebied";
"bgt_gebouwinstallatie";
"bgt_kunstwerkdeel";
"bgt_onbegroeidterreindeel";
"bgt_ondersteunendwegdeel";
"bgt_overigescheiding";
"bgt_scheiding";
"bgt_spoor";
"bgt_tunneldeel";
# ----------------------------------------

code_block_2 = CodeBlock { Directory; }
code_block_3 = CodeBlock(RDx=code_block.out0) { RDx; }
code_block_4 = CodeBlock(RDy=code_block.out1) { RDy; }
width = CodeBlock { 250; }
code_block_5 = CodeBlock(BoundingboxWidth=width) { BoundingboxWidth; }

# group: PLACE TREES
code_block_6 = CodeBlock { 17; }
getItemAtIndex = List.GetItemAtIndex(index=code_block_6)  # unwired: list
string_2 = StringInput(".//{http://www.opengis.net/gml}pos")
filterGML = Custom[GIS2BIM.FilterGML](GMLFile=getItemAtIndex, xPATH=string_2, CoordinateX=code_block_3, CoordinateY=code_block_4, Boundingbox=code_block_5)  # filter GML-file based on boundingbox
flatten = Flatten(filterGML.Points)

activeView = Custom[Springs.Doc.ActiveView]()  # Selects the current document's active view. Supports more view types than the built-in option. Will be depreciated once the bult in node works with all plan types.
code_block_7 = CodeBlock(View=activeView) { View; }

# group: clockwork familyinstance by point in view
code_block_8 = CodeBlock(item=flatten) { Flatten({item}); }
python_script = Python(IN[0]=code_block_8, IN[2]=code_block_7)  # unwired: IN[1]
# ---------- python_script.python (31 lines) ----------
import clr
clr.AddReference('RevitAPI')
from Autodesk.Revit.DB import *

clr.AddReference("RevitNodes")
import Revit
clr.ImportExtensions(Revit.Elements)
clr.ImportExtensions(Revit.GeometryConversion)

clr.AddReference("RevitServices")
import RevitServices
from RevitServices.Persistence import DocumentManager
from RevitServices.Transactions import TransactionManager

doc = DocumentManager.Instance.CurrentDBDocument
points = UnwrapElement(IN[0])
famtype = UnwrapElement(IN[1])
lvl = UnwrapElement(IN[2])
elementlist = list()
counter = 0

TransactionManager.Instance.EnsureInTransaction(doc)
# make sure familysymbol is active
if famtype.IsActive == False:
	famtype.Activate()
	doc.Regenerate()
for point in points:
	newobj = doc.Create.NewFamilyInstance(point.ToXyz(),famtype,lvl)
	elementlist.append(newobj.ToDSType(False))
TransactionManager.Instance.TransactionTaskDone()
OUT = elementlist
# ----------------------------------------
python_script_2 = Python(IN[0]=flatten, IN[1]=python_script)
# ---------- python_script_2.python (4 lines) ----------
check = IN[0]
items = IN[1]
if isinstance(check, (list)): OUT = items
else: OUT = items[0]
# ----------------------------------------

code_block_9 = CodeBlock(x=python_script_2) { x; }
string_3 = StringInput("imgeo:tekst")
code_block_10 = CodeBlock { "Dordrecht"; "werf van schouten"; "501"; }
getLocationdataNetherlands = Custom[GIS2BIM.GetLocationdataNetherlands](City=code_block_10.out0, Streetname=code_block_10.out1, Housenumber=code_block_10.out2)  # Gives locationdata based on an adress in the Netherlands
code_block_11 = CodeBlock { "C:/TEMP/15893"; }
BGTGeometry = Custom[GIS2BIM.BGTGeometry](Directory=code_block_11, RDx=code_block_3, RDy=code_block_4, BoundingboxWidth=code_block_5)  # Returns BGT-curves and metadata(Dutch GEO)
string_4 = StringInput(".//{http://www.opengis.net/gml}posList")

# group: Puntvormige elementen
bgt_lagen = CodeBlock()
# ---------- bgt_lagen.designscript (11 lines) ----------
"bgt_bak";
"bgt_bord";
"bgt_kast";
"bgt_mast";
"bgt_paal";
"bgt_put";
"bgt_sensor";
"bgt_straatmeubilair";
"bgt_vegetatieobject";
"bgt_waterinrichtingselement";
"bgt_wegrichtingselement";
# ----------------------------------------
create = List.Create(bgt_lagen.out0, bgt_lagen.out1, bgt_lagen.out2, bgt_lagen.out3, bgt_lagen.out4, bgt_lagen.out5, bgt_lagen.out6, bgt_lagen.out7, bgt_lagen.out8, bgt_lagen.out9, bgt_lagen.out10)
code_block_12 = CodeBlock { "/"; }
code_block_13 = CodeBlock { ".gml"; }
concat = String.Concat(code_block_11, code_block_12, arg3=code_block_13)  # unwired: arg2
map = List.Map(list=create, f_x=concat)

code_block_14 = CodeBlock(a=map) { a[0]; }
string_5 = StringInput(".//{http://www.opengis.net/gml}pos")
string_6 = StringInput(".//{http://www.geostandaarden.nl/imgeo/2.1}plus-type")
filterGMLPointsMetadata = Custom[GIS2BIM.FilterGMLPointsMetadata](GMLFile=code_block_14, XpathPoints=string_5, XpathMetadata=string_6, CoordinateX=code_block_3, CoordinateY=code_block_4, Boundingbox=code_block_5)  # Filter GML-file based on boundingbox and create points and belonging meta-data
