# Dynamo graph SVG test.dyn (Dynamo 1.3.4.6666)

code_block = CodeBlock { "zwijndrecht"; "wattstraat"; "17"; }
code_block_2 = CodeBlock { "dordrecht"; "lange geldersekade"; "1"; }
getLocationdataNetherlands = Custom[GIS2BIM.GetLocationdataNetherlands](City=code_block_2.out0, Streetname=code_block_2.out1, Housenumber=code_block_2.out2)  # Gives locationdata based on an adress in the Netherlands
code_block_3 = CodeBlock { 200; }
createBoundingBox = Custom[GIS2BIM.CreateBoundingBox](CoordinateX=getLocationdataNetherlands.RDcoordinateXmeters, CoordinateY=getLocationdataNetherlands.RDcoordinateYmeters, BoxWidth=code_block_3, BoxHeight=code_block_3)  # create boundingboxstring for webrequests based on coördinates and dimensions
geoservicesLibraryNetherlands = Custom[GIS2BIM.GeoservicesLibraryNetherlands](BoundingBox=createBoundingBox.Boxstring)  # Library with multiple webadresses which can be used for WFS and WMS webrequests
webrequestWMS2 = Custom[GIS2BIM.WebrequestWMS2](WMSwebrequest=geoservicesLibraryNetherlands.TOP10NL_OGC_WMS)  # a webrequest based on WMS-protocol
watch_image = WatchImageCore(webrequestWMS2)
code_block_4 = CodeBlock { "dordrecht"; "werf van schouten"; "501"; }
code_block_5 = CodeBlock { "dordrecht"; "lange geldersekade"; "1"; }
code_block_6 = CodeBlock()
# ---------- code_block_6.designscript (17 lines) ----------
//Tree
Off = 2000;
 //offset from ground
D = 3500;
 //diameter
H = 10000;
 //total height
H2 = H-Off;
 //total height min offset
P1 = Point.ByCoordinates(0,0,H-H2/2);
plne = Plane.ByOriginNormal(P1,Vector.YAxis());
A2 = EllipseArc.ByPlaneRadiiAngles(plne,H2/2,D/2,0,180);
sld1 = Solid.ByRevolve(A2, Point.ByCoordinates(0, 0, 0), Vector.ByCoordinates(0, 0, 1), 0, 360);
crcle = Circle.ByCenterPointRadius(Point.ByCoordinates(0,0,0),200);
sld2 = crcle.ExtrudeAsSolid(Off+200);
solds = {sld1,sld2};
sld = Solid.ByUnion(solds);
# ----------------------------------------

# group: OPEN STREETMAPS
code_block_7 = CodeBlock { Point.ByCoordinates(0,0,0); }
code_block_8 = CodeBlock { "28992"; "4326"; }
doubleToString = Custom[GIS2BIM.DoubleToString](CoordinateDouble=getLocationdataNetherlands.RDcoordinateXmeters)  # Converts a double to a string
doubleToString_2 = Custom[GIS2BIM.DoubleToString](CoordinateDouble=getLocationdataNetherlands.RDcoordinateYmeters)
transformCRS_epsg = Custom[GIS2BIM.TransformCRS_epsg](sourceCRS=code_block_8.out0, targetCRS=code_block_8.out1, xCoordinate=doubleToString, yCoordinate=doubleToString_2)  # Uses the API of http://epsg.io to transform Coordinate Reference Systems
doubleToString_3 = Custom[GIS2BIM.DoubleToString](CoordinateDouble=transformCRS_epsg.Ytransformed)
doubleToString_4 = Custom[GIS2BIM.DoubleToString](CoordinateDouble=transformCRS_epsg.Xtransformed)
createBoundingBoxLATLONG = Custom[GIS2BIM.CreateBoundingBoxLATLONG](Lat=doubleToString_3, Long=doubleToString_4, WidthMeters=code_block_3)  # create boundingbox with from lat/long coordinate in degrees
code_block_9 = CodeBlock { "C:/TEMP/map6.osm"; }
downloadOSM = Custom[GIS2BIM.DownloadOSM](West=createBoundingBoxLATLONG.West, East=createBoundingBoxLATLONG.East, North=createBoundingBoxLATLONG.North, South=createBoundingBoxLATLONG.South, Directory=code_block_9)  # Download OSM data within a boundingbox
python_script = Python(IN[0]=downloadOSM.DownloadlinkOSM, IN[1]=downloadOSM.Directory)
# ---------- python_script.python (10 lines) ----------
import sys
sys.path.append("C:\Program Files (x86)\IronPython 2.7\Lib")
from System.Net import WebClient

url= IN[0]
filoc= IN[1]

WebClient().DownloadFile(url, filoc)

OUT= filoc
# ----------------------------------------
location = Elk.OSM.Location(python_script)
code_block_10 = CodeBlock { "natural"; "tree"; "building"; "tree"; }
OSMData = Elk.OSM.OSMData(location, python_script, code_block_10.out0, code_block_10.out1)
byOrigin = CoordinateSystem.ByOrigin()
code_block_11 = CodeBlock(b=code_block_3) { b; -b*1000/2; }
byOrigin_2 = CoordinateSystem.ByOrigin(code_block_11.out1, code_block_11.out1)
transform = Geometry.Transform(geometry=OSMData, fromCoordinateSystem=byOrigin, contextCoordinateSystem=byOrigin_2)
flatten = Flatten(transform)
byTwoPoints = Vector.ByTwoPoints(start=code_block_7, end=flatten)

translate = Geometry.Translate(geometry=code_block_6.sld, direction=byTwoPoints)
code_block_12 = CodeBlock(fces=translate) { Display.ByGeometryColor(fces,Color.ByARGB(255,223,230,208)); }

# group: SVG TO CURVES
code_block_13 = CodeBlock { fces = t6; display1 = Display.ByGeometryColor(fces, Color.ByARGB(255,234,234,234)); }  # unwired: t6
code_block_14 = CodeBlock { fces = t6; display1 = Display.ByGeometryColor(fces, Color.ByARGB(255, 205, 230, 237)); }  # unwired: t6
web_request = WebRequest(geoservicesLibraryNetherlands.TOP10NL_wegdeelvlak_OGC_WMS_SVG)
code_block_15 = CodeBlock(b=code_block_3) { b; }
SVGToCurves = Custom[GIS2BIM.SVGToCurves](SVGString=web_request, Width=code_block_15, Height=code_block_15)  # Beta version of converting SVG to Curves
web_request_2 = WebRequest(geoservicesLibraryNetherlands.TOP10NL_waterdeelvlak_OGC_WMS_SVG)
SVGToCurves_2 = Custom[GIS2BIM.SVGToCurves](SVGString=web_request_2, Width=code_block_15, Height=code_block_15)

code_block_16 = CodeBlock { "C:/TEMP/TEST.tiff"; }
AHN3toPoints = Custom[GIS2BIM.AHN3toPoints](Rdx=getLocationdataNetherlands.RDcoordinateXmeters, Rdy=getLocationdataNetherlands.RDcoordinateYmeters, BoundinxboxWidth=code_block_3, FilepathName=code_block_16)  # Load AHN3 via Geotiff WCS. Transform to local coordinates
code_block_17 = CodeBlock { 50; }
takeEveryNthItem = List.TakeEveryNthItem(AHN3toPoints.Points, code_block_17)
byPoints = Topography.ByPoints(takeEveryNthItem)

# group: BAG 3D
BAG3D = Custom[GIS2BIM.BAG3D](3D_BAG_TU_Delft_OGC_WFS=geoservicesLibraryNetherlands.3D_BAG_TU_Delft_OGC_WFS, rdx=getLocationdataNetherlands.RDcoordinateXmeters, rdy=getLocationdataNetherlands.RDcoordinateYmeters)  # Perform a WFS(Web Feature Service) webrequest based on a boundingbox of RD-coordinates(28992). Retrieve an xml-file. Read the metadata and create 3D-solids. Maximum of 1000 buildings per request.

categories = Categories("MassForm")
code_block_18 = CodeBlock { "NLRS_90_MASS_building"; }
byGeometry = DirectShape.ByGeometry(geometry=BAG3D.BAG_3DSolidUnion, category=categories, name=code_block_18)
